# Dynamo graph SP_Estudo_Plano.dyn (Dynamo 2.3.0.5885)

rota_plano_de_projeção = DoubleSlider(0, range=0..90 step 10)  # "Rota Plano de Projeção Horizontal"
SP_Sistema_Diedrico = Custom[SP_Sistema_Diedrico]()  # Cria os planos de projeção

# group: Plano 1
abscissa = DoubleSlider(3.5, range=0..5 step 0.1)
afastamento = DoubleSlider(2.8, range=0..5 step 0.1)
cota = DoubleSlider(1, range=0..5 step 0.1)
SP_Locar_Ponto = Custom[SP_Locar_Ponto](Planos_de_Projeção=SP_Sistema_Diedrico, abscissa=abscissa, Afastamento=afastamento, Cota=cota)  # Localiza um ponto em Sistema Diedrico
abscissa_2 = DoubleSlider(0.8, range=0..5 step 0.1)
afastamento_2 = DoubleSlider(2.4, range=0..5 step 0.1)
cota_2 = DoubleSlider(1, range=0..5 step 0.1)
SP_Locar_Ponto_2 = Custom[SP_Locar_Ponto](Planos_de_Projeção=SP_Sistema_Diedrico, abscissa=abscissa_2, Afastamento=afastamento_2, Cota=cota_2)
abscissa_3 = DoubleSlider(2.3, range=0..5 step 0.1)
afastamento_3 = DoubleSlider(3.5, range=0..5 step 0.1)
cota_3 = DoubleSlider(1, range=0..5 step 0.1)
SP_Locar_Ponto_3 = Custom[SP_Locar_Ponto](Planos_de_Projeção=SP_Sistema_Diedrico, abscissa=abscissa_3, Afastamento=afastamento_3, Cota=cota_3)

SP_Locar_Plano = Custom[SP_Locar_Plano](P1=SP_Locar_Ponto, P2=SP_Locar_Ponto_2, P3=SP_Locar_Ponto_3)  # Posiciona um plano a partir de 3 pontos
SP_Rotacionar_Plano = Custom[SP_Rotacionar_Plano](Angulo=rota_plano_de_projeção, Plano=SP_Locar_Plano)  # Rotaciona o plano de projeção horizontal para formar a Epura 2D
